# Grasshopper definition Color Mapping.gh (Grasshopper 1.0.7)
# plug-ins: Bifocals, Pufferfish

number_slider = Slider(97, range=1..100)

# ----
# Color Mapping of Surface
surface = Surface(<surface referenced from the Rhino model>)
project = Project(Geometry=surface, Plane=PlaneXY(0, 0, 0))  # -> Geometry, Transform
unit_z = UnitZ(Factor="20")
divide_domain² = DivideDomain²(Domain=surface, UCount=number_slider, VCount=number_slider)
move = Move(Geometry=project.Geometry, Motion=unit_z)  # -> Geometry, Transform
isotrim = Isotrim(Surface=surface, Domain=divide_domain²)
divide_surface = DivideSurface(Surface=move.Geometry, UCount=10, VCount=10)  # -> simplify(flatten(Points)), Normals, Parameters
area = Area(Geometry=isotrim)  # -> Area, Centroid
closest_point = ClosestPoint(Point=area.Centroid, Cloud=divide_surface.Points)  # -> ClosestPoint, CPIndex, Distance
remap = Remap(data=closest_point.Distance, min="0", max="1")
gradient = Gradient(
    LowerLimit="0",
    UpperLimit="1",
    Parameter=remap,
    stops=[0: RGB(243, 57, 0), 0.1: RGB(236, 27, 60), 0.2: RGB(210, 0, 118), 0.3: RGB(103, 0, 120), 0.4: RGB(39, 72, 161), 0.5: RGB(1, 192, 229), 0.6: RGB(18, 178, 90), 0.7: RGB(79, 186, 8), 0.8: RGB(220, 237, 32), 0.9: RGB(247, 159, 20), 1: RGB(243, 57, 0)])
custom_preview = CustomPreview(Geometry=isotrim, Material=gradient)

# ----
# Larger Count = More Precise
panel = Panel("50")

# ----
# CAD Terrain Lines to Surface
# 1. Bake
# (Surface Result)
curve = Curve([<curve referenced from the Rhino model> x38])
discontinuity = Discontinuity(Curve=curve, Level="3")  # -> flatten(Points), Parameters
delaunay_mesh = DelaunayMesh(Points=discontinuity.Points, Plane=PlaneXY(0, 0, 0))
addition = Addition(A=panel, B="1")

# ----
# 1.bake
# 2. _TONURBS
# (Mesh Result)
quad_remesh = QuadRemesh(Mesh=delaunay_mesh, Settings={aqc=True, as=50, dhe=True, gci=0, null=False, pme=0, sa=0, tqc=2000})

# ----
# Get the Highest Point
bounding_box = BoundingBox(Content=quad_remesh, Plane=PlaneXY(0, 0, 0))  # -> Box, Box_2
deconstruct_box = DeconstructBox(Box=bounding_box.Box)  # -> Plane, X, Y, Z

# ----
# Color Mapping
# 1.bake
# 2. _TONURBS
# (Polysurface Result)
subd_from_mesh = SubDFromMesh(Mesh=quad_remesh, Creases=1, Corners=1, Interpolate=False)

mesh_naked_edges = MeshNakedEdges(Mesh=quad_remesh)  # -> Naked, ResultBoolean
project_2 = Project(Geometry=mesh_naked_edges.Naked, Plane=PlaneXY(0, 0, 0))  # -> Geometry, Transform
unit_z_2 = UnitZ(Factor=deconstruct_box.Z)
move_2 = Move(Geometry=project_2.Geometry, Motion=unit_z_2)  # -> Geometry, Transform

# ----
# Ensures all points land on surface when projected
number_slider_2 = Slider(0.99, range=0..1)
area_2 = Area(Geometry=move_2.Geometry)  # -> Area, Centroid
scale = Scale(Geometry=move_2.Geometry, Center=area_2.Centroid, Factor=number_slider_2)  # -> Geometry, Transform

surface_2 = Surface(scale.Geometry)
divide_surface_2 = DivideSurface(Surface=surface_2, UCount=panel, VCount=panel)  # -> Points, Normals, Parameters
project_point = ProjectPoint(Point=divide_surface_2.Points, Direction=Vector(0, 0, -1), Geometry=quad_remesh)  # -> flatten(Point), Index
surface_from_points = SurfaceFromPoints(Points=project_point.Point, UCount=addition, Interpolate=False)

# ==== cluster Remap: Remaps numbers
data = ClusterInput()
min = ClusterInput()
max = ClusterInput()
bnd = Bounds(Numbers=data)
dom = ConstructDomain(DomainStart=min, DomainEnd=max)
remap = RemapNumbers(Value=data, Source=bnd, Target=dom)  # -> Mapped, Clipped
R = ClusterOutput(remap.Mapped)
